# Grasshopper definition CityBuilder_new.gh (Grasshopper 0.9.76)
# plug-ins: CORE.GH, HDTReference, LunchBox

# ---- group: Auto-update
auto_update_leave_this_off = BooleanToggle(False)

# ----
# area units (for tags)
panel = Panel(" Ft²")

# ----
# bake lot boundaries to:
panel_2 = Panel("PW2_2-Lot_")

# ----
# setback lines with width
# remove this text
panel_3 = Panel("PW1_3-Setback_*")

# ----
# use zone boundaries
panel_4 = Panel("PW1_4-Zone_")

# ----
# Lot boundary
panel_5 = Panel("PW1_6-LotBoundaries")

# ----
# setback area boundaries
panel_6 = Panel("PW1_3-SetbackAreas")

# ----
# LAYER NAME PATTERNS in RHINOCEROS
# You will need to ensure that the Rhino
# file you are using has layer names
# matching patterns identified here in order
# for Grasshopper to pull geometry in
# correctly.
# 
# Note the use of the wildcard (*) character
# project phase boundaries
panel_7 = Panel("PW1_1-PhaseBoundary_*")

# ----
# Building footprints
panel_8 = Panel("PW1_9-Building_*")

# ----
# ROW centerlines
panel_9 = Panel("PW1_2-Centerline_*")
# * = wildcard
panel_10 = Panel("PW1_2-Centerline_")

# ----
# zero-width dividing lines
panel_11 = Panel("PW1_2-ZeroWidth")

# ----
# units (used in Excel
# column names)
# SHEET MAPPING to EXCEL
# Enter the sheet number where the
# following data will be dumped as
# a table
# 
# Note: nothing else should exist on
# that sheet, or it will be overwritten
panel_12 = Panel("FEET")

bake_to_pw_2_layers = Button()
clean_pw_2_layers = Button()

# ----
# COLOR KEY
# INPUTS
# WRITES TO EXCEL
write_data = Button()

# ----
# BLOCKS
panel_13 = Panel("1")

# ----
# INTERSECTIONS
panel_14 = Panel("3")

# ----
# BUILDING FOOTPRINTS
panel_15 = Panel("4")

# ----
# STREETS
panel_16 = Panel("5")

# ----
# LOTS
panel_17 = Panel("2")

# ----
# PHASES
panel_18 = Panel("6")

# ---- group: Get Layers
layertable = LayerTable(Update=True, AutoUpdate=auto_update_leave_this_off)  # -> Layers, FullLayerPaths, LayerColors, Linetypes, MaterialNames, Visible, PrintWidth, PrintColor
# WRITES TO RHINO
data = Data(layertable.Layers)
data_2 = Data(layertable.LayerColors)

# ---- group: Layer Colors
data_3 = Data(data_2)

# ---- group: Layers as List
data_4 = Data(data)

# ----
# READ PHASE LAYERS
panel_19 = Panel(panel_7)
data_5 = Data(data_4)
tmatch = MatchText(Text=data_5, Pattern=panel_19, Case=True)
cull = CullPattern(List=data_5, CullPattern=tmatch)
dpipeline = DynamicGeometryPipeline(
    LayerFilter=cull,
    TypeFilter="curve",
    NameFilter="*",
    enableFullPath=False,
    GroupByLayer=False,
    GroupByType=False,
    IncludeHidden=True,
    IncludeLocked=True)
reb = RebuildCurve(Curve=dpipeline, Degree=1, Count=1000, Tangents=False)
topoly = CurveToPolyline(Curve=reb, ToleranceDistance=0, ToleranceAngle=0.05)  # -> Polyline, Segments

# ----
# Read Use Zones Layers
panel_20 = Panel("PW1_4-Zone_*")
data_6 = Data(data_4)
tmatch_2 = MatchText(Text=data_6, Pattern=panel_20, Case=True)
cull_2 = CullPattern(List=data_6, CullPattern=tmatch_2)
dpipeline_2 = DynamicGeometryPipeline(
    LayerFilter=cull_2,
    TypeFilter="curve",
    NameFilter="*",
    enableFullPath=False,
    GroupByLayer=False,
    GroupByType=False,
    IncludeHidden=True,
    IncludeLocked=True)
panel_21 = Panel(panel_4)
rep = ReplaceText(Text=cull_2, Find=panel_21, RecursiveReplace=False)
panel_22 = Panel("")
reb_2 = RebuildCurve(Curve=dpipeline_2, Degree=1, Count=1000, Tangents=False)
rep_2 = ReplaceText(Text=rep, Find=panel_22, RecursiveReplace=False)
topoly_2 = CurveToPolyline(Curve=reb_2, ToleranceDistance=0, ToleranceAngle=0.05)  # -> Polyline, Segments

# ----
# Read ZeroWidth layer
panel_23 = Panel(panel_11)
data_7 = Data(data_4)
tmatch_3 = MatchText(Text=data_7, Pattern=panel_23, Case=True)
cull_3 = CullPattern(List=data_7, CullPattern=tmatch_3)
dpipeline_3 = DynamicGeometryPipeline(
    LayerFilter=cull_3,
    TypeFilter="curve",
    NameFilter="*",
    enableFullPath=False,
    GroupByLayer=False,
    GroupByType=False,
    IncludeHidden=True,
    IncludeLocked=True)

panel_24 = Panel(tmatch_2)

# ---- group: Phase Layer Names
data_8 = Data(cull)

# ---- group: PHASE NAMES
data_9 = Data(data_8)

# ---- group: PHASE LAYER POLYGONS
data_10 = Data(topoly.Polyline)

# ---- group: ZONE NAMES
data_11 = Data(rep_2)

# ---- group: ZONE BOUNDARIES
data_12 = Data(topoly_2.Polyline)

# ----
# CREATE BLOCKS FROM CENTRELINE LAYERS
panel_25 = Panel("2")

# ---- group: PHASE NAMES
data_13 = Data(data_9)

# ---- group: PHASE CURVES
crv = Curve(data_10)

# ---- group: PHASE NAMES
data_14 = Data(data_9)

# ---- group: PHASE AREAS
crv_2 = Curve(data_10)

# ----
graft = GraftTree(Tree=data_14, IncludeEmptyLists=True, IncludeNullItems=True)
area = Area(Geometry=crv_2)  # -> Area, Centroid

join = JoinCurves(Curves=dpipeline_3, Preserve=False)

# ---- group: PHASE NAMES
data_15 = Data(data_13)

# ---- group: PHASE AREAS
crv_3 = Curve(crv)

# ----
# WRITE TO EXCEL
entwine = Entwine(Branch00=graft, Branch01=area.Area, FlattenInputs=True)
panel_26 = Panel(panel_12)
concat = Concatenate(FragmentA="PHASE_AREA_", FragmentB=panel_26)
merge = Merge(Data1="PHASE_NAME", Data2=concat)
graft_2 = GraftTree(Tree=merge, IncludeEmptyLists=True, IncludeNullItems=True)
merge_2 = Merge(Data1=graft_2, Data2=entwine)
panel_27 = Panel(panel_18)
writexl = WriteToExcel(Run=write_data, ExcelWorksheet=panel_27, WriteOptions="None", ColumnnsOrRows=False, DataToWriteIntoColumns=merge_2)

# ---- group: PHASE NAMES
data_16 = Data(data_9)

# ---- group: ZONE NAMES
data_17 = Data(data_11)

# ---- group: ZONE CURVES
data_18 = Data(data_12)

# ---- group: PHASE CURVES
crv_4 = Curve(data_10)

# ---- group: PHASE NAMES
data_19 = Data(data_16)

# ---- group: PHASE LAYER POLYGONS
data_20 = Data(crv_4)

# ---- group: PHASE NAMES
# BLOCKS
data_21 = Data(data_16)

# ---- group: PHASE AREAS
crv_5 = Curve(crv_4)

# ----
# READ FUNCTION LAYERS
data_22 = Data(data_5)
tmatch_4 = MatchText(Text=data_22, Pattern="*_Zones", Case=True)
cull_4 = CullPattern(List=data_22, CullPattern=tmatch_4)

# ---- group: FIND PHASE BLOCK IS IN / PHASE NAMES
data_23 = Data(data_21)

# ---- group: PHASE AREAS
crv_6 = Curve(crv_5)

# ---- group: PHASE NAMES
data_24 = Data(data_16)

# ---- group: ZONE CURVES
data_25 = Data(data_18)

# ---- group: ZONE NAMES
data_26 = Data(data_17)

# ---- group: PHASE CURVES
crv_7 = Curve(crv_4)

# ---- group: PHASE NAMES
data_27 = Data(data_24)

# ---- group: ZONE BOUNDARIES
data_28 = Data(data_25)

# ---- group: ZONE NAMES
data_29 = Data(data_26)

# ---- group: PHASE AREAS
# LOTS
crv_8 = Curve(crv_7)

# ----
# Read Boundary layers
# WRITE TOTALS TO RHINO SCREEN
panel_28 = Panel(panel_5)
data_30 = Data(data_4)
tmatch_5 = MatchText(Text=data_30, Pattern=panel_28, Case=True)
cull_5 = CullPattern(List=data_30, CullPattern=tmatch_5)
dpipeline_4 = DynamicGeometryPipeline(
    LayerFilter=cull_5,
    TypeFilter="curve",
    NameFilter="*",
    enableFullPath=False,
    GroupByLayer=False,
    GroupByType=False,
    IncludeHidden=True,
    IncludeLocked=True)

# ---- group: ZONE NAME
data_31 = Data(data_29)

# ---- group: PHASE NAMES
data_32 = Data(data_27)

# ---- group: ZONE CURVES
crv_9 = Curve(data_28)

# ---- group: PHASE AREAS
crv_10 = Curve(crv_8)

# ----
# Read  Footprint layers
data_33 = Data(data_4)
panel_29 = Panel(panel_8)
# FOOTPRINTS
tmatch_6 = MatchText(Text=data_33, Pattern=panel_29, Case=True)
cull_6 = CullPattern(List=data_33, CullPattern=tmatch_6)
dpipeline_5 = DynamicGeometryPipeline(
    LayerFilter=cull_6,
    TypeFilter="curve",
    NameFilter="*",
    enableFullPath=False,
    GroupByLayer=False,
    GroupByType=False,
    IncludeHidden=True,
    IncludeLocked=True)

# ---- group: PHASE NAMES
data_34 = Data(data_24)

# ---- group: ZONE NAMES
data_35 = Data(data_26)

# ---- group: ZONE CURVES
data_36 = Data(data_25)

# ---- group: PHASE CURVES
crv_11 = Curve(crv_7)

# ---- group: ZONE BOUNDARIES
data_37 = Data(data_36)

# ---- group: PHASE NAMES
data_38 = Data(data_34)

# ---- group: ZONE NAMES
data_39 = Data(data_35)

# ---- group: PHASE AREAS
crv_12 = Curve(crv_11)

# ----
# GET BUILDING FOOTPRINTS
area_2 = Area(Geometry=dpipeline_5)  # -> Area, Centroid

# ---- group: MAKE IDs
lng = ListLength(List=flatten(dpipeline_5))
series = Series(Start="1", Step=1, Count=lng)
round = Round(Number=series)  # -> flatten(Nearest), Floor, Ceiling

# ---- group: AREAS
data_40 = Data(area_2.Area)

# ---- group: CENTROIDS
pt = Point(area_2.Centroid)

# ---- group: BLDG CENTROIDS
pt_2 = Point(pt)

# ---- group: LAYER LIST
data_41 = Data(data_4)

# ---- group: LAYER COLORS
data_42 = Data(data_3)

# ---- group: BLDG CENTROIDS
pt_3 = Point(pt_2)

pt_4 = Point(pt_2)

pt_5 = Point(pt_2)

pt_6 = Point(pt_2)

# ---- group: PHASE NAMES
data_43 = Data(data_38)

# ---- group: AREA NAME
data_44 = Data(data_39)

# ---- group: PHASE AREAS
crv_13 = Curve(crv_12)

# ---- group: AREA CURVES
crv_14 = Curve(data_37)

# ----
incurves = PointInCurves(Point=pt_3, Curves=crv_14)  # -> simplify(Relationship), Index, Point
flip = FlipMatrix(Data=incurves.Relationship)
cull_7 = CullPattern(List=data_44, CullPattern=flip)

incurves_2 = PointInCurves(Point=pt_5, Curves=crv_13)  # -> simplify(Relationship), Index, Point
flip_2 = FlipMatrix(Data=incurves_2.Relationship)
cull_8 = CullPattern(List=data_43, CullPattern=flip_2)
clean = CleanTree(RemoveNulls=True, RemoveInvalid=True, RemoveEmpty=True, Tree=simplify(cull_8), SynchronousTree1=simplify(graft(data_43)))  # -> Tree, flatten(SynchronousTree1)

# ---- group: AREA NAMES
flip_3 = FlipMatrix(Data=cull_7)  # -> flatten(Data)

# ---- group: PHASE LAYER
flip_4 = FlipMatrix(Data=clean.Tree)  # -> flatten(Data)

# ---- group: IDs
data_45 = Data(round.Nearest)

# ---- group: AREAS
data_46 = Data(data_40)

# ---- group: ZONE
data_47 = Data(flip_3)

# ----
# Read Setback area layer and distribute offset distances
panel_30 = Panel(panel_6)
data_48 = Data(data_4)
tmatch_7 = MatchText(Text=data_48, Pattern=panel_30, Case=True)
cull_9 = CullPattern(List=data_48, CullPattern=tmatch_7)
dpipeline_6 = DynamicGeometryPipeline(
    LayerFilter=cull_9,
    TypeFilter="curve",
    NameFilter="*",
    enableFullPath=False,
    GroupByLayer=False,
    GroupByType=False,
    IncludeHidden=True,
    IncludeLocked=True)
join_2 = JoinCurves(Curves=dpipeline_6, Preserve=False)

# ---- group: PHASE ID
data_49 = Data(flip_4)

# ----
panel_31 = Panel(panel)

# ----
# Read Centreline layers and distribute offset distances
panel_32 = Panel(panel_9)
data_50 = Data(data_4)
tmatch_8 = MatchText(Text=data_50, Pattern=panel_32, Case=True)
cull_10 = CullPattern(List=data_50, CullPattern=tmatch_8)

tsort = SortText(Keys=cull_10, Culture=127)  # -> Keys, Values

rep_3 = ReplaceText(Text=tsort.Keys, Find=panel_10, RecursiveReplace=False)
dpipeline_7 = DynamicGeometryPipeline(
    LayerFilter=tsort.Keys,
    TypeFilter="curve",
    NameFilter="*",
    enableFullPath=False,
    GroupByLayer=False,
    GroupByType=False,
    IncludeHidden=True,
    IncludeLocked=True)
graft_3 = GraftTree(Tree=rep_3, IncludeEmptyLists=True, IncludeNullItems=True)

# ---- group: CENTRELINE LAYERS
data_51 = Data(cull_10)

# ---- group: CENTRELINES
crv_15 = Curve(dpipeline_7)

crv_16 = Curve(crv_15)

# ---- group: CENTRELINE LAYERS
data_52 = Data(data_51)

# ---- group: CENTRELINES
# PHASES
crv_17 = Curve(crv_15)

# ----
# STREETS
graft_4 = GraftTree(Tree=data_52, IncludeEmptyLists=True, IncludeNullItems=True)
len = Length(Curve=crv_17)
ma = MassAddition(Input=len)  # -> Result, PartialResults

# ---- group: CREATE INTERSECTIONS
mcx = MultipleCurves(Curves=flatten(crv_16))  # -> Points, IndexA, IndexB, ParamA, ParamB
# INTERSECTIONS
lng_2 = ListLength(List=mcx.Points)  # -> flatten(Length)

# ---- group: INTERSECTIONS
pt_7 = Point(mcx.Points)

# ----
# WRITE TO EXCEL
panel_33 = Panel("STREET_LAYER")
entwine_2 = Entwine(Branch00=graft_4, Branch01=ma.Result, FlattenInputs=True)
panel_34 = Panel(panel_12)
concat_2 = Concatenate(FragmentA="TOTAL_LENGTH_", FragmentB=panel_34)
merge_3 = Merge(Data1=panel_33, Data2=concat_2)
graft_5 = GraftTree(Tree=merge_3, IncludeEmptyLists=True, IncludeNullItems=True)
merge_4 = Merge(Data1=graft_5, Data2=entwine_2)
panel_35 = Panel(panel_16)
writexl_2 = WriteToExcel(Run=write_data, ExcelWorksheet=panel_35, WriteOptions="None", ColumnnsOrRows=False, DataToWriteIntoColumns=merge_4)

# ---- group: FIND WHICH PHASE AREA INTERSECTIONS LIE IN
incurves_3 = PointInCurves(Point=pt_7, Curves=crv_3)  # -> simplify(Relationship), Index, Point
flip_5 = FlipMatrix(Data=incurves_3.Relationship)
cull_11 = CullPattern(List=data_15, CullPattern=flip_5)
clean_2 = CleanTree(
    RemoveNulls=True,
    RemoveInvalid=True,
    RemoveEmpty=True,
    Tree=simplify(cull_11),
    SynchronousTree1=simplify(graft(data_15)))  # -> Tree, flatten(SynchronousTree1)

# ---- group: PHASE LAYER
flip_6 = FlipMatrix(Data=clean_2.Tree)

# ----
tbi = TreeBranchIndex(DataTree=flip_6, BranchIndex="0")  # -> flatten(Branch)
cset = CreateSet(List=tbi)  # -> Set, Map
mindex = MemberIndex(Set=tbi, Member=cset.Set)  # -> Index, flatten(Count)
tbi_2 = TreeBranchIndex(DataTree=mindex.Count, BranchIndex="0")  # -> flatten(Branch)

# ----
# WRITE TO EXCEL
entwine_3 = Entwine(Branch00=cset.Set, Branch01=tbi_2, FlattenInputs=True)
panel_36 = Panel("""LOCATION
INTERSECTIONS""")
graft_6 = GraftTree(Tree=panel_36, IncludeEmptyLists=True, IncludeNullItems=True)
merge_5 = Merge(Data1=graft_6, Data2=entwine_3)
panel_37 = Panel(panel_14)
writexl_3 = WriteToExcel(Run=write_data, ExcelWorksheet=panel_37, WriteOptions="None", ColumnnsOrRows=False, DataToWriteIntoColumns=merge_5)

# ---- group: CENTRELINE LAYERS
data_53 = Data(data_51)

# ---- group: CENTRELINES
crv_18 = Curve(crv_15)

# ----
num = Number(graft_3)
graft_7 = GraftTree(Tree=num, IncludeEmptyLists=True, IncludeNullItems=True)

# ----
# Close or Open Fix
crv_19 = Curve(dpipeline_7)
cls = Closed(Curve=crv_19)  # -> Closed, Periodic
dispatch = Dispatch(List=crv_19, DispatchPattern=cls.Closed)  # -> ListA, ListB
shatter = Shatter(Curve=reparameterize(dispatch.ListA), Parameters=[0.5, 0])
graft_8 = GraftTree(Tree=dispatch.ListB, IncludeEmptyLists=True, IncludeNullItems=True)

lng_3 = ListLength(List=crv_19)
dup = DuplicateData(Data=graft_7, Number=lng_3, Order=True)
trim = TrimTree(Tree=dup, Depth=panel_25)
graft_9 = GraftTree(Tree=trim, IncludeEmptyLists=True, IncludeNullItems=True)
clean_3 = CleanTree(RemoveNulls=True, RemoveInvalid=True, RemoveEmpty=invert(False), Tree=graft_9)
trim_2 = TrimTree(Tree=clean_3, Depth=1)
int = Integer(trim_2)

trim_3 = TrimTree(Tree=shatter, Depth=1)
graft_10 = GraftTree(Tree=trim_3, IncludeEmptyLists=True, IncludeNullItems=True)

merge_6 = Merge(Data1=graft_8, Data2=graft_10)
clean_4 = CleanTree(RemoveNulls=True, RemoveInvalid=True, RemoveEmpty=invert(False), Tree=merge_6)
trim_4 = TrimTree(Tree=clean_4, Depth=1)

division = Division(A=int, B="2")

# ----
# Offset CL's and create closed polylines
offset = Offset(Curve=trim_4, Distance=expr("-x", division), Plane=PlaneXY(0, 0, 0), Corners=1)
offset_2 = Offset(Curve=trim_4, Distance=division, Plane=PlaneXY(0, 0, 0), Corners=1)
end = EndPoints()  # -> Start, End
end_2 = EndPoints(Curve=offset_2)  # -> Start, End
end_3 = EndPoints(Curve=offset)  # -> Start, End
merge_7 = Merge(Data1=end.Start, Data2=end.End)
ln = Line(StartPoint=end_2.End, EndPoint=end_3.End)
ln_2 = Line(StartPoint=end_2.Start, EndPoint=end_3.Start)
circle = CircleCNR(Center=merge_7, Normal=Vector(0, 0, 1), Radius=int)  # -> flatten(Circle)
merge_8 = Merge(Data1=ln_2, Data2=offset_2, Data3=ln, Data4=offset)
clean_5 = CleanTree(RemoveNulls=True, RemoveInvalid=True, RemoveEmpty=invert(False), Tree=merge_8)
join_3 = JoinCurves(Curves=clean_5, Preserve=False)

# ----
# Create Blocks
trim_5 = TrimTree(Tree=join_3, Depth=2)
runion = RegionUnion(Curves=flatten(trim_5))  # -> flatten(Result)
boundary = BoundarySurfaces(Edges=runion)
wires = BrepWireframe(Brep=graft(boundary), Density=-1)
join_4 = JoinCurves(Curves=wires, Preserve=False)
area_3 = Area(Geometry=join_4)  # -> Area, Centroid
sort = SortList(Keys=area_3.Area, ValuesA=join_4)  # -> Keys, ValuesA
shift = ShiftList(List=sort.ValuesA, Shift=-1, Wrap=False)
topoly_3 = CurveToPolyline(Curve=shift, ToleranceDistance=0, ToleranceAngle=0.05)  # -> Polyline, Segments

rdiff = RegionDifference(CurvesA=flatten(join), CurvesB=flatten(runion))
boundary_2 = BoundarySurfaces(Edges=rdiff)
wires_2 = BrepWireframe(Brep=graft(boundary_2), Density=-1)
join_5 = JoinCurves(Curves=wires_2, Preserve=False)
merge_9 = Merge(Data1=topoly_3.Polyline, Data2=join_5)

# ---- group: BLOCK CURVES
crv_20 = Curve(merge_9)

# ---- group: BLOCK BOUNDARIES
data_54 = Data(crv_20)

# ----
# GET BLOCK INFORMATION
area_4 = Area(Geometry=data_54)  # -> flatten(Area), flatten(Centroid)

# ---- group: MAKE IDs
lng_4 = ListLength(List=flatten(data_54))
series_2 = Series(Start="1", Step=1, Count=lng_4)
round_2 = Round(Number=series_2)  # -> flatten(Nearest), Floor, Ceiling

# ---- group: AREAS
data_55 = Data(area_4.Area)

# ---- group: BLOCK IDs
data_56 = Data(round_2.Nearest)

# ---- group: CENTROIDS
pt_8 = Point(area_4.Centroid)

# ---- group: FIND PHASE BLOCK IS IN / BLOCK CENTROIDS
pt_9 = Point(pt_8)

# ---- group: FIND PHASE BLOCK IS IN
incurves_4 = PointInCurves(Point=pt_9, Curves=crv_6)  # -> simplify(Relationship), Index, Point
flip_7 = FlipMatrix(Data=incurves_4.Relationship)
cull_12 = CullPattern(List=data_23, CullPattern=flip_7)
clean_6 = CleanTree(
    RemoveNulls=True,
    RemoveInvalid=True,
    RemoveEmpty=True,
    Tree=simplify(cull_12),
    SynchronousTree1=simplify(graft(data_23)))  # -> Tree, flatten(SynchronousTree1)

# ---- group: BLOCK IDs
data_57 = Data(data_56)

# ---- group: BLOCK CURVES
crv_21 = Curve(crv_20)

# ---- group: FIND PHASE BLOCK IS IN / PHASE LAYER
flip_8 = FlipMatrix(Data=clean_6.Tree)

# ---- group: BLOCK IDs
data_58 = Data(data_56)

# ---- group: BLOCK AREAS
data_59 = Data(data_55)

# ---- group: BLOCK CENTROIDS
pt_10 = Point(pt_8)

# ----
# WRITE TO EXCEL
panel_38 = Panel("BLOCK_")
panel_39 = Panel("""PHASE
BLOCK_ID""")
concat_3 = Concatenate(FragmentA=panel_38, FragmentD=data_58)
panel_40 = Panel(panel_12)
concat_4 = Concatenate(FragmentA="BLOCK_AREA_", FragmentB=panel_40)
entwine_4 = Entwine(Branch00=flip_8, Branch01=concat_3, Branch02=data_59, FlattenInputs=True)
merge_10 = Merge(Data1=panel_39, Data2=concat_4)
graft_11 = GraftTree(Tree=merge_10, IncludeEmptyLists=True, IncludeNullItems=True)
merge_11 = Merge(Data1=graft_11, Data2=entwine_4)
panel_41 = Panel(panel_13)
writexl_4 = WriteToExcel(Run=write_data, ExcelWorksheet=panel_41, WriteOptions="None", ColumnnsOrRows=False, DataToWriteIntoColumns=merge_11)

# ---- group: AREAS
data_60 = Data(data_59)

# ---- group: CENTROIDS
pt_11 = Point(pt_10)

# ----
# TAG EACH BLOCK
panel_42 = Panel(" BLOCK_")
xz = XZPlane(Origin=pt_11)
xz_2 = XZPlane(Origin=pt_11)
concat_5 = Concatenate(FragmentF=flip_8, FragmentA=panel_42, FragmentD=data_58, FragmentB=" ", FragmentE="AREA:", FragmentC=data_60)
rotate = Rotate(Geometry=xz_2, Angle="0.25", Plane=xz)  # -> Geometry, Transform
xy = XYPlane(Origin=pt_11)
rotate_2 = Rotate(Geometry=rotate.Geometry, Angle="1", Plane=xy)  # -> Geometry, Transform
tag = TextTag3D(Location=rotate_2.Geometry, Text=concat_5, Size=Slider(3.865, range=1..10), Justification=7)

# ---- group: BLOCK IDs
data_61 = Data(data_57)

# ---- group: BLOCK CURVES
data_62 = Data(crv_21)

# ----
# CREATE LOTS FROM BLOCKS WITH BOUNDARY LAYERS
data_63 = Data(data_62)
cls_2 = Closed(Curve=data_63)  # -> Closed, Periodic
dispatch_2 = Dispatch(List=data_63, DispatchPattern=cls_2.Closed)  # -> ListA, ListB
boundary_3 = BoundarySurfaces(Edges=dispatch_2.ListA)
srfsplit = SurfaceSplit(Surface=boundary_3, Curves=dpipeline_4)  # -> flatten(Fragments)
wires_3 = BrepWireframe(Brep=srfsplit, Density=-1)
join_6 = JoinCurves(Curves=wires_3, Preserve=False)  # -> flatten(Curves)
area_5 = Area(Geometry=join_6)  # -> Area, Centroid

# ---- group: MAKE IDs
lng_5 = ListLength(List=flatten(join_6))
series_3 = Series(Start="1", Step=1, Count=lng_5)
round_3 = Round(Number=series_3)  # -> flatten(Nearest), Floor, Ceiling

# ---- group: AREAS
data_64 = Data(area_5.Area)

# ---- group: LOT CURVES
crv_22 = Curve(join_6)

# ---- group: CENTROIDS
pt_12 = Point(area_5.Centroid)

# ---- group: LOT CENTROIDS
pt_13 = Point(pt_12)

pt_14 = Point(pt_13)

pt_15 = Point(pt_13)

# ---- group: FIND BLOCK LOT IS IN / LOT CENTROIDS
pt_16 = Point(pt_13)

# ---- group: FIND BLOCK LOT IS IN / BLOCK BOUNDARIES
data_65 = Data(flatten(data_62))

# ---- group: FIND BLOCK LOT IS IN / BLOCK IDs
data_66 = Data(data_61)

# ---- group: FIND PHASE LOT IS IN
incurves_5 = PointInCurves(Point=pt_15, Curves=crv_10)  # -> simplify(Relationship), Index, Point
flip_9 = FlipMatrix(Data=incurves_5.Relationship)
cull_13 = CullPattern(List=data_32, CullPattern=flip_9)
clean_7 = CleanTree(
    RemoveNulls=True,
    RemoveInvalid=True,
    RemoveEmpty=True,
    Tree=simplify(cull_13),
    SynchronousTree1=simplify(graft(data_32)))  # -> Tree, flatten(SynchronousTree1)

# ---- group: FIND ZONE LOT IS IN
incurves_6 = PointInCurves(Point=pt_14, Curves=crv_9)  # -> simplify(Relationship), Index, Point
flip_10 = FlipMatrix(Data=incurves_6.Relationship)
cull_14 = CullPattern(List=data_31, CullPattern=flip_10)

# ---- group: FIND BLOCK LOT IS IN
incurves_7 = PointInCurves(Point=pt_16, Curves=data_65)  # -> simplify(Relationship), Index, Point
item = ListItem(List=data_66, Index=incurves_7.Index, Wrap=True)
data_67 = Data(item)

# ---- group: ZONE NAMES
flip_11 = FlipMatrix(Data=cull_14)

# ---- group: PHASE LAYER
flip_12 = FlipMatrix(Data=clean_7.Tree)

# ---- group: LOT CURVES
crv_23 = Curve(crv_22)

# ---- group: LOT BLOCK ID
data_68 = Data(item)

# ---- group: LOT AREAS
data_69 = Data(area_5.Area)

# ---- group: BLOCK IDs
data_70 = Data(data_57)

# ---- group: LOT PHASE ID
data_71 = Data(flip_12)

# ---- group: LOT ZONE
data_72 = Data(flip_11)

# ---- group: LOT IDs
data_73 = Data(round_3.Nearest)

# ---- group: BLOCK CURVES
crv_24 = Curve(crv_21)

# ---- group: LOT CURVES
crv_25 = Curve(crv_23)

# ---- group: CENTROIDS
pt_17 = Point(area_5.Centroid)

# ---- group: BLOCK CURVES
data_74 = Data(crv_24)

# ---- group: BLOCK IDs
data_75 = Data(data_70)

# ---- group: LOT CURVES
# SETBACKS
data_76 = Data(crv_25)

# ---- group: ZONES
data_77 = Data(data_72)

# ---- group: LOT CURVES
data_78 = Data(crv_25)

# ----
# BAKE
panel_43 = Panel(panel_2)
concat_6 = Concatenate(FragmentA=panel_43, FragmentB=data_77)
concat_7 = Concatenate(FragmentA=panel_43, FragmentB=data_77)
fsim = FindSimilarMember(Data=concat_7, Set=data_41)  # -> Hit, Index
index = ItemIndex(List=data_41, Item=fsim.Hit)
item_2 = ListItem(List=data_42, Index=index, Wrap=False)

# ---- group: BLOCK BOUNDARIES
data_79 = Data(flatten(data_74))

# ---- group: BLOCK IDs
data_80 = Data(data_75)

# ---- group: LOT IDs
data_81 = Data(data_73)

# ---- group: LOT BOUNDARIES
data_82 = Data(flatten(crv_25))

# ----
incurves_8 = PointInCurves(Point=pt_6, Curves=data_82)  # -> simplify(Relationship), Index, Point
item_3 = ListItem(List=data_81, Index=incurves_8.Index, Wrap=True)
data_83 = Data(flatten(item_3))

incurves_9 = PointInCurves(Point=pt_4, Curves=data_79)  # -> simplify(Relationship), Index, Point
item_4 = ListItem(List=data_80, Index=incurves_9.Index, Wrap=True)
data_84 = Data(flatten(item_4))

# ----
# BAKE LOTS WITH ZONES TO LAYERS
clean_8 = CleanTree(
    RemoveNulls=True,
    RemoveInvalid=True,
    RemoveEmpty=True,
    Tree=simplify(data_78),
    SynchronousTree1=simplify(concat_6),
    SynchronousTree2=simplify(item_2))  # -> Tree, SynchronousTree1, SynchronousTree2
bake = ObjectBake(
    BakeToggle=bake_to_pw_2_layers,
    GeometryObjects=simplify(clean_8.Tree),
    Layer=simplify(clean_8.SynchronousTree1),
    ObjectName="GH_Obj",
    ObjectColor=simplify(clean_8.SynchronousTree2),
    LayerColor=simplify(clean_8.SynchronousTree2))
delonlay = DeleteOnLayer(Run=clean_pw_2_layers, Layer=clean_8.SynchronousTree1, enableFullPath=False)

# ---- group: BLOCK IDs
data_85 = Data(data_84)

# ---- group: IDs
data_86 = Data(data_83)

# ----
concat_8 = Concatenate(FragmentA="BLOCK_", FragmentB=data_85)
concat_9 = Concatenate(FragmentA="LOT_", FragmentB=data_86)
concat_10 = Concatenate(FragmentA="BLDG_", FragmentB=data_45)

# ---- group: LOT CURVES
data_87 = Data(data_76)

# ----
# WRITE TO EXCEL
panel_44 = Panel("""PHASE
BLOCK_ID
LOT_ID
BLDG_ID
ZONE""")
panel_45 = Panel(panel_12)
entwine_5 = Entwine(
    Branch00=data_49,
    Branch01=concat_8,
    Branch02=concat_9,
    Branch03=concat_10,
    Branch04=data_47,
    Branch05=data_46,
    FlattenInputs=True)
concat_11 = Concatenate(FragmentA="BLDG_AREA_", FragmentB=panel_45)
merge_12 = Merge(Data1=panel_44, Data2=concat_11)
flip_13 = FlipMatrix(Data=entwine_5)
graft_12 = GraftTree(Tree=merge_12, IncludeEmptyLists=True, IncludeNullItems=True)
merge_13 = Merge(Data1=graft_12, Data2=entwine_5)
panel_46 = Panel(panel_15)
writexl_5 = WriteToExcel(Run=write_data, ExcelWorksheet=panel_46, WriteOptions="None", ColumnnsOrRows=False, DataToWriteIntoColumns=merge_13)

# ---- group: LOT BLOCK ID
data_88 = Data(data_68)

# ---- group: LOT PHASE ID
data_89 = Data(data_71)

# ---- group: LOT ZONE
data_90 = Data(data_72)

# ---- group: LOT IDs
data_91 = Data(data_73)

# ---- group: LOT AREAS
data_92 = Data(data_69)

# ---- group: LOT CURVES
crv_26 = Curve(crv_25)

# ---- group: CENTROIDS
pt_18 = Point(pt_17)

# ---- group: LOT CURVES
crv_27 = Curve(crv_26)

# ---- group: LOT BLOCK ID
data_93 = Data(data_88)

# ---- group: LOT PHASE ID
data_94 = Data(data_89)

# ---- group: LOT ZONE
data_95 = Data(data_90)

# ---- group: LOT IDs
data_96 = Data(data_91)

# ---- group: LOT AREAS
data_97 = Data(data_92)

# ---- group: LOT CURVES
crv_28 = Curve(crv_26)

# ---- group: CENTROIDS
pt_19 = Point(pt_18)

# ---- group: PHASE ID
data_98 = Data(data_94)

# ---- group: ZONE
data_99 = Data(data_95)

# ---- group: BLOCK IDs
data_100 = Data(data_93)

# ----
# SHOW LOT BOUNDARIES
# LOTS
crv_29 = Curve(crv_28)

# ---- group: LOT AREAS
data_101 = Data(data_97)

# ---- group: IDs
data_102 = Data(data_96)

# ---- group: LOT CENTROIDS
pt_20 = Point(pt_19)

# ----
round_4 = Round(Number=data_101)  # -> Nearest, Floor, Ceiling
panel_47 = Panel(panel)
concat_12 = Concatenate(FragmentA="BLOCK_", FragmentB=data_100)
concat_13 = Concatenate(FragmentA="LOT_", FragmentB=data_102)
concat_14 = Concatenate(FragmentA="LOT_AREA: ", FragmentB=round_4.Nearest, FragmentC=panel_47)

# ---- group: PHASE ID
data_103 = Data(data_98)

# ---- group: ZONE
data_104 = Data(data_99)

# ---- group: LOT CENTROIDS
pt_21 = Point(pt_20)

# ----
# DESIGNATE BLOCKS IN PHASE AREAS
crv_30 = Curve(crv_20)
area_6 = Area(Geometry=crv_30)  # -> Area, Centroid
incurves_10 = PointInCurves(Point=area_6.Centroid, Curves=data_20)  # -> simplify(Relationship), Index, Point
cull_15 = CullPattern(List=crv_30, CullPattern=incurves_10.Relationship)
clean_9 = CleanTree(
    RemoveNulls=True,
    RemoveInvalid=True,
    RemoveEmpty=True,
    Tree=simplify(cull_15),
    SynchronousTree1=simplify(graft(data_19)))  # -> Tree, flatten(SynchronousTree1)

# ---- group: SUM AND ROUND AREAS
area_7 = Area(Geometry=clean_9.Tree)  # -> Area, Centroid
ma_2 = MassAddition(Input=area_7.Area)  # -> flatten(Result), PartialResults
round_5 = Round(Number=ma_2.Result)  # -> Nearest, Floor, Ceiling

# ----
concat_15 = Concatenate(FragmentA=clean_9.SynchronousTree1, FragmentB=" Block Area: ", FragmentC=round_5.Ceiling)

# ---- group: PHASE BLOCK AREA STRINGS
data_105 = Data(concat_15)

# ----
# DESIGNATE BLOCKS IN PHASE AND FUNCTION AREAS
data_106 = Data(clean_9.SynchronousTree1)
crv_31 = Curve(clean_9.Tree)
tstat = TreeStatistics(Tree=crv_31)  # -> Paths, Length, Count
repeat = RepeatData(Data=graft(cull_4), Length=tstat.Count)
tstat_2 = TreeStatistics(Tree=cull_4)  # -> Paths, Length, Count
crv_32 = Curve(simplify(crv_31))
cluster = Cluster(crv=crv_32)
flip_14 = FlipMatrix(Data=repeat)
dpipeline_8 = DynamicGeometryPipeline(
    LayerFilter=flip_14,
    TypeFilter="curve",
    NameFilter="*",
    enableFullPath=False,
    GroupByLayer=False,
    GroupByType=False,
    IncludeHidden=True,
    IncludeLocked=True)  # -> simplify(GeometryOut)
dup_2 = DuplicateData(Data=crv_32, Number=tstat_2.Length, Order=True)
dup_3 = DuplicateData(Data=cluster, Number=tstat_2.Length, Order=True)
lng_6 = ListLength(List=crv_32)
reb_3 = RebuildCurve(Curve=dpipeline_8, Degree=1, Count=1000, Tangents=False)
partition = PartitionList(List=dup_2, Size=lng_6)  # -> simplify(Chunks)
partition_2 = PartitionList(List=dup_3, Size=lng_6)  # -> simplify(Chunks)
topoly_4 = CurveToPolyline(Curve=reb_3, ToleranceDistance=0, ToleranceAngle=0.05)  # -> Polyline, Segments
incurves_11 = PointInCurves(Point=partition_2, Curves=topoly_4.Polyline)  # -> Relationship, Index, Point
cull_16 = CullPattern(List=partition, CullPattern=incurves_11.Relationship)
area_8 = Area(Geometry=cull_16)  # -> Area, Centroid
ma_3 = MassAddition(Input=area_8.Area)  # -> Result, PartialResults
path_mapper = PathMapper(ma_3.Result, source="{A;B}", target="{A}")
round_6 = Round(Number=path_mapper)  # -> Nearest, Floor, Ceiling
concat_16 = Concatenate(FragmentC=round_6.Ceiling)

data_107 = Data(cull_4)
split = TextSplit(Text=data_107, Separators="_")
item_5 = ListItem(List=split, Index=1, Wrap=True)
data_108 = Data(data_106)

concat_17 = Concatenate(FragmentD=graft(data_108), FragmentE=": ", FragmentA=flatten(item_5))

# ----
# DISPLAY NUMBERS ON SCREEN
data_109 = Data(data_105)
data_110 = Data(concat_16)
data_111 = Data(concat_17)
data_112 = Data(data_105)
ins = InsertItems(List=data_111, Item=graft(data_112), Indices=0, Wrap=True)
ins_2 = InsertItems(List=data_110, Item=graft(""), Indices=0, Wrap=True)
ins_3 = InsertItems(List=ins, Indices=-1, Wrap=True)
number_slider = Slider(20, range=0..100)
ins_4 = InsertItems(List=ins_2, Indices=-1, Wrap=True)
lng_7 = ListLength(List=flatten(ins_3))
addition = Addition(A=number_slider, B=Slider(244, range=-101..300))
series_4 = Series(Start=Slider(41, range=0..100), Step=Slider(18, range=0..100), Count=lng_7)
swatch = ColourSwatch(SwatchColor=RGB(255, 255, 255))
pt_22 = ConstructPoint(XCoordinate=number_slider, YCoordinate=series_4, ZCoordinate=0)
pt_23 = ConstructPoint(XCoordinate=addition, YCoordinate=series_4, ZCoordinate=0)
texttoscreen = RenderTextToScreen(Text=flatten(ins_4), Location=pt_23, Size=12, Color=swatch, m_scWithvp=False)
texttoscreen_2 = RenderTextToScreen(Text=flatten(ins_3), Location=pt_22, Size=12, Color=swatch, m_scWithvp=False)

# ----
# Read Setback layers and distribute offset distances
panel_48 = Panel(panel_3)
data_113 = Data(data_4)
tmatch_9 = MatchText(Text=data_113, Pattern=panel_48, Case=True)
cull_17 = CullPattern(List=data_113, CullPattern=tmatch_9)

tsort_2 = SortText(Keys=cull_17, Culture=127)  # -> Keys, Values

rep_4 = ReplaceText(Text=tsort_2.Keys, Find="PW1_3-Setback_", RecursiveReplace=False)
dpipeline_9 = DynamicGeometryPipeline(
    LayerFilter=tsort_2.Keys,
    TypeFilter="curve",
    NameFilter="*",
    enableFullPath=False,
    GroupByLayer=False,
    GroupByType=False,
    IncludeHidden=True,
    IncludeLocked=True)
graft_13 = GraftTree(Tree=rep_4, IncludeEmptyLists=True, IncludeNullItems=True)

# ---- group: GET CURVES PER LAYER
crv_33 = Curve(dpipeline_9)

# ---- group: CREATE LIST OF OFFSET LENGTHS TO MATCH CURVES
lng_8 = ListLength(List=crv_33)
dup_4 = DuplicateData(Data=graft_13, Number=lng_8, Order=True)
trim_6 = TrimTree(Tree=dup_4, Depth=1)
graft_14 = GraftTree(Tree=trim_6, IncludeEmptyLists=True, IncludeNullItems=True)
clean_10 = CleanTree(RemoveNulls=True, RemoveInvalid=True, RemoveEmpty=invert(False), Tree=graft_14)

# ---- group: SPLIT CURVES INTO SECTIONS
explode = Explode(Curve=crv_33, Recursive=True)  # -> Segments, Vertices
clean_11 = CleanTree(RemoveNulls=True, RemoveInvalid=True, RemoveEmpty=invert(False), Tree=explode.Segments)

# ---- group: REMOVE "HOOK" INTO LOT
lng_9 = ListLength(List=clean_11)
subtraction = Subtraction(A=lng_9, B="2")
max = Maximum(A="0", B=subtraction)
dom = ConstructDomain(DomainStart="0", DomainEnd=max)
subset = SubList(List=clean_11, Domain=dom, Wrap=True)  # -> List, Index
join_7 = JoinCurves(Curves=subset.List, Preserve=False)
trim_7 = TrimTree(Tree=join_7, Depth="2")

# ---- group: GET "HOOK" INTO LOT
lng_10 = ListLength(List=clean_11)
subtraction_2 = Subtraction(A=lng_10, B="1")
max_2 = Maximum(A="0", B=subtraction_2)
item_6 = ListItem(List=clean_11, Index=max_2, Wrap=True)
end_4 = EndPoints(Curve=item_6)  # -> Start, End

# ----
int_2 = Integer(clean_10)

# ---- group: OFFSET AND MERGE CURVES
offset_3 = Offset(Curve=trim_7, Distance=expr("-x", int_2), Plane=PlaneXY(0, 0, 0), Corners=1)
offset_4 = Offset(Curve=trim_7, Distance=int_2, Plane=PlaneXY(0, 0, 0), Corners=1)
end_5 = EndPoints(Curve=offset_3)  # -> Start, End
end_6 = EndPoints(Curve=offset_4)  # -> Start, End
ln_3 = Line(StartPoint=end_6.End, EndPoint=end_5.End)
ln_4 = Line(StartPoint=end_6.Start, EndPoint=end_5.Start)
merge_14 = Merge(Data1=ln_4, Data2=offset_4, Data3=ln_3, Data4=offset_3)
clean_12 = CleanTree(RemoveNulls=True, RemoveInvalid=True, RemoveEmpty=invert(False), Tree=merge_14)
join_8 = JoinCurves(Curves=clean_12, Preserve=False)
trim_8 = TrimTree(Tree=join_8, Depth="2")

# ----
panel_49 = Panel(int_2)
panel_50 = Panel(end_4.End)
panel_51 = Panel(trim_7)

# ---- group: FIND LOT POINT IS IN
pt_24 = Point(end_4.End)
incurves_12 = PointInCurves(Point=pt_24, Curves=data_87)  # -> Relationship, Index, Point
item_7 = ListItem(List=data_87, Index=incurves_12.Index, Wrap=True)

# ----
graft_15 = GraftTree(Tree=trim_8, IncludeEmptyLists=True, IncludeNullItems=True)
graft_16 = GraftTree(Tree=item_7, IncludeEmptyLists=True, IncludeNullItems=True)
rint = RegionIntersection(CurvesA=graft_15, CurvesB=graft_16)  # -> flatten(Result)

# ---- group: Union if > 1, Single curve if 1
merge_15 = Merge(Data1=flatten(rint), Data2=join_2)  # -> flatten(Result)
lng_11 = ListLength(List=merge_15)
runion_2 = RegionUnion(Curves=merge_15)  # -> flatten(Result)
larger = LargerThan(FirstNumber=lng_11, SecondNumber="1")  # -> LargerThan, OrEqualTo
smaller = SmallerThan(FirstNumber=lng_11, SecondNumber="2")  # -> SmallerThan, OrEqualTo
graft_17 = GraftTree(Tree=runion_2, IncludeEmptyLists=True, IncludeNullItems=True)
graft_18 = GraftTree(Tree=merge_15, IncludeEmptyLists=True, IncludeNullItems=True)
merge_16 = Merge(Data1=larger.LargerThan, Data2=smaller.SmallerThan)
merge_17 = Merge(Data1=graft_18, Data2=graft_17)
sift = SiftPattern(List=merge_17, SiftPattern=merge_16)  # -> Output0, Output1

# ----
# SHOW SETBACK BOUNDARIES
boundary_4 = BoundarySurfaces(Edges=sift.Output0)

# ---- group: SETBACK CURVES
crv_34 = Curve(sift.Output0)

# ----
# CALCULATE BUILDABLE AREA
boundary_5 = BoundarySurfaces(Edges=crv_27)
srfsplit_2 = SurfaceSplit(Surface=flatten(boundary_5), Curves=flatten(crv_34))
item_8 = ListItem(List=srfsplit_2, Index=Slider(0, range=0..100), Wrap=True)  # -> flatten(Item)
flip_15 = FlipMatrix(Data=srfsplit_2)
lng_12 = ListLength(List=srfsplit_2)
flatten = FlattenTree(Tree=srfsplit_2, Path="{0}")
lng_13 = ListLength(List=flatten)
area_9 = Area(Geometry=boundary_5)  # -> flatten(Area), Centroid
area_10 = Area(Geometry=item_8)  # -> Area, Centroid
panel_52 = Panel(lng_13)
subtraction_3 = Subtraction(A=area_9.Area, B=area_10.Area)
abs = Absolute(Value=subtraction_3)
larger_2 = LargerThan(FirstNumber=abs, SecondNumber="0.01")  # -> LargerThan, OrEqualTo
cull_18 = CullPattern(List=flip_15, CullPattern=larger_2.LargerThan)  # -> flatten(List)

# ---- group: LOT CENTROIDS
pt_25 = Point(area_9.Centroid)

# ----
incurve = PointInCurve(Point=graft(pt_25), Curve=flatten(cull_18))  # -> Relationship, Point
larger_3 = LargerThan(FirstNumber=incurve.Relationship, SecondNumber=0)  # -> simplify(LargerThan), OrEqualTo
cull_19 = CullPattern(List=cull_18, CullPattern=larger_3.LargerThan)
area_11 = Area(Geometry=cull_19)  # -> graft(Area), Centroid
null = NullItem(Item=area_11.Area)  # -> NullFlags, InvalidFlags, Description
p_n_c = PickNChoose(Pattern=null.NullFlags, Stream0=area_11.Area)  # -> flatten(Result)

# ---- group: LOT BUILDABLE AREA
data_114 = Data(p_n_c)

# ----
concat_18 = Concatenate(FragmentA="LOT_BUILDABLE: ", FragmentB=data_114, FragmentC=panel_31)

# ---- group: LOT BUILDABLE AREA
data_115 = Data(concat_18)

# ----
# WRITE TO EXCEL
panel_53 = Panel("""PHASE
BLOCK_ID
LOT_ID
ZONE""")
panel_54 = Panel("""LOT_AREA_
LOT_AREA_BUILDABLE_""")
panel_55 = Panel(panel_12)
entwine_6 = Entwine(
    Branch00=data_103,
    Branch01=concat_12,
    Branch02=concat_13,
    Branch03=data_104,
    Branch04=data_101,
    Branch05=data_114,
    FlattenInputs=True)
concat_19 = Concatenate(FragmentA=panel_54, FragmentB=panel_55)
merge_18 = Merge(Data1=panel_53, Data2=concat_19)
graft_19 = GraftTree(Tree=merge_18, IncludeEmptyLists=True, IncludeNullItems=True)
merge_19 = Merge(Data1=graft_19, Data2=entwine_6)
panel_56 = Panel(panel_17)
writexl_6 = WriteToExcel(Run=write_data, ExcelWorksheet=panel_56, WriteOptions="None", ColumnnsOrRows=False, DataToWriteIntoColumns=merge_19)

# ----
# TAG EACH LOT
panel_57 = Panel("")
xy_2 = XYPlane(Origin=pt_21)
concat_20 = Concatenate(
    FragmentH=data_103,
    FragmentE=panel_57,
    FragmentF=concat_12,
    FragmentA=panel_57,
    FragmentD=concat_13,
    FragmentB=panel_57,
    FragmentG=data_104,
    FragmentI=panel_57,
    FragmentC=concat_14,
    FragmentJ=panel_57,
    FragmentK=data_115)
rotate_3 = Rotate(Geometry=xy_2, Angle="0", Plane=xy_2)  # -> Geometry, Transform
tag_2 = TextTag3D(Location=rotate_3.Geometry, Text=concat_20, Size=Slider(1.349, range=1..10), Justification=7)

# ==== cluster Cluster
crv = ClusterInput()
crv_2 = Curve(crv)
area = Area(Geometry=crv_2)  # -> Area, Centroid
boundary = BoundarySurfaces(Edges=crv_2)
srf_cp = SurfaceClosestPoint(Point=area.Centroid, Surface=boundary)  # -> Point, UVPoint, Distance
vec2pt = Vector2Pt(PointA=area.Centroid, PointB=srf_cp.Point, Unitize=False)  # -> Vector, Length
unit = UnitVector(Vector=vec2pt.Vector)
amp = Amplitude(Vector=unit, Amplitude=5)
move = Move(Geometry=srf_cp.Point, Motion=amp)  # -> Geometry, Transform
project = Project(Geometry=move.Geometry, Plane=PlaneXY(0, 0, 0))  # -> Geometry, Transform
G = ClusterOutput(project.Geometry)
